# Grasshopper definition example_shpere_01.gh (Grasshopper 1.0.7)

sphere = Sphere(Base=PlaneXY(0, 0, 0), Radius=Slider(18, range=0..100))
mesh = Mesh(sphere)
triangulate = Triangulate(Mesh=mesh)  # -> Mesh, Count
deconstruct_mesh = DeconstructMesh(Mesh=triangulate.Mesh)  # -> Vertices, Faces, Colours, Normals
panel = Panel(deconstruct_mesh.Faces)
panel_2 = Panel(deconstruct_mesh.Vertices)
